# Grasshopper definition 1-1.gh (Grasshopper 0.9.76)

# Number Slider 可輸出浮點數、整數、奇數、偶數，可設定數字範圍和精度，可變更名稱。
panel = Panel("""設計運算概論
Rhino + Grasshopper 1-1""")
number_slider = Slider(-25, range=-50..50)
panel_2 = Panel("建構點與線段的連鎖關係")

pt = Point(Point(-6, 12, 0))
pt_2 = Point(Point(-21, 9, 0))
ln = Line(StartPoint=pt_2, EndPoint=pt)

panel_3 = Panel("數值序列(Series)與交叉配對(Cross-Reference)")
panel_4 = Panel("值域(Domain)與數值區間(Range)")
panel_5 = Panel("亂數產生器是根據亂數種子(Seed)生成看似亂數的數值，但仍然是被計算出來的。")
# 數值輸入時，較少變動數值用 Panel，較常變動用 Slider。
# 數值之間可以建立多重關聯性。
age = Slider(10, range=1..20)
dom = ConstructDomain(DomainStart="0", DomainEnd="3")
addition = Addition(A=number_slider, B="25")
multiplication = Multiplication(A=number_slider, B=Slider(0.5, range=0..1))

curvepoint = PointOnCurve(ln, parameter=0.42)
pt_3 = Point(Point(-17, 0, 0))
ln_2 = Line(StartPoint=curvepoint, EndPoint=pt_3)

random = Random(Range=Domain(0, 1), Number="10", Seed=Slider(2, range=0..10))
series = Series(Start=Slider(0, range=0..5), Step=Slider(1.415, range=0..5), Count=Slider(9, range=1..20))
series_2 = Series(Start=Slider(0, range=0..5), Step=Slider(1.529, range=0..5), Count=Slider(7, range=1..20))
range = Range(Domain=dom, Steps="5")
pt_4 = ConstructPoint(XCoordinate="-30", YCoordinate="10", ZCoordinate="5")
pt_5 = ConstructPoint(XCoordinate=number_slider, YCoordinate=addition, ZCoordinate=multiplication)
crossref = CrossReference(ListA=series, ListB=series_2, CrossMode=1)  # -> ListA, ListB
panel_6 = Panel(random)
# Panel 就像便利貼，可當文字記錄，可顯示輸出結果，可當作資料輸入。可變更字體、顏色、格式。
panel_7 = Panel(age)
panel_8 = Panel(range)
ln_3 = Line(StartPoint=pt_4, EndPoint=pt_5)
pt_6 = ConstructPoint(XCoordinate=crossref.ListA, YCoordinate=crossref.ListB, ZCoordinate=0)

curvepoint_2 = PointOnCurve(ln_2, parameter=0.397)
pt_7 = Point(Point(-4, -4, 0))
ln_4 = Line(StartPoint=curvepoint_2, EndPoint=pt_7)

circle = Circle3Pt(PointA=curvepoint_2, PointB=curvepoint, PointC=pt)  # -> Circle, Plane, Radius
panel_9 = Panel("三點建構圓")
panel_10 = Panel("顯示點的順序")
points = PointList(Points=pt_6, Size=Slider(0.449, range=0..1))
pt_8 = Point(circle.Plane)
panel_11 = Panel("圓心")
panel_12 = Panel("兩條切線建構圓")
circlett = CircleTanTan(CurveA=ln_4, CurveB=ln, Point=pt_8)
