# Grasshopper definition example-1-2.gh (Grasshopper 0.9.76)

panel = Panel("""設計運算概論
Rhino + Grasshopper 1-2""")
number_slider = Slider(0, range=0..1)
pt = Point(Point(0, 0, 0))
# 曲線上取點的簡易元件為 Point on Curve，但無法外部指定參數，欠缺彈性。建議多熟悉 Evaluate Curve 元件，只是要記得對匯入曲線進行重新參數化(Reparameterize)，參數範圍才會是0...1。
crv = Curve(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)
crv_2 = Curve(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)
cir = Circle(Plane=pt, Radius=Slider(10, range=1..100))
divide = DivideCurve(Curve=cir, Count=Slider(6, range=1..10), Kinks=False)  # -> Points, Tangents, Parameters
panel_2 = Panel("""用Shift List平移資料串列：
從p0-p1-p2-p3變為p1-p2-p3-p0。""")
panel_3 = Panel("圓上等分點相連為線段，線段上取點再彼此相連為新線段，依此方式重複數次。")
eval = EvaluateCurve(Curve=reparameterize(crv), Parameter=number_slider)  # -> Point, Tangent, Angle
eval_2 = EvaluateCurve(Curve=reparameterize(crv_2), Parameter=number_slider)  # -> Point, Tangent, Angle
number_slider_2 = Slider(0.268, range=0..1)

shift = ShiftList(List=divide.Points, Shift=1, Wrap=True)
ln = Line(StartPoint=divide.Points, EndPoint=shift)
eval_3 = EvaluateCurve(Curve=ln, Parameter=number_slider_2)  # -> Point, Tangent, Angle

panel_4 = Panel("取相同參數位置")

shift_2 = ShiftList(List=eval_3.Point, Shift=1, Wrap=True)
ln_2 = Line(StartPoint=eval_3.Point, EndPoint=shift_2)
eval_4 = EvaluateCurve(Curve=ln_2, Parameter=number_slider_2)  # -> Point, Tangent, Angle

shift_3 = ShiftList(List=eval_4.Point, Shift=1, Wrap=True)
ln_3 = Line(StartPoint=eval_4.Point, EndPoint=shift_3)
eval_5 = EvaluateCurve(Curve=ln_3, Parameter=number_slider_2)  # -> Point, Tangent, Angle
